# Grasshopper definition comparison.gh (Grasshopper 1.0.7)
# plug-ins: MeshEdit Components

# ---- group: Find epw file
panel = Panel("https://www.energyplus.net/weather-download/europe_wmo_region_6/DNK//DNK_Copenhagen.061800_IWEC/all")
epwmap = LBEPWmap(epw_map=Toggle(False))  # -> report; plug-in component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

# ---- group: Output folder
should_not_contain_whitespace = Panel("C:\Simulation")

# ----
downloadepw = LBDownloadWeather(weather_URL=panel)  # -> epw_file, stat_file, ddy_file; plug-in component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

# ---- group: Rooms
brep = Brep([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])

# ---- group: Context
brep_2 = Brep([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])

# ---- group: This is created for LBT version 1.2.0
# Inputs
panel_2 = Panel("1.2.0")
versioner = LBVersioner(update=Toggle(False), version=panel_2)  # -> Vviiiiiz; plug-in component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

# ---- group: Window parameters
number_slider = Slider(1.2, range=0..4)
number_slider_2 = Slider(1, range=0..4)
number_slider_3 = Slider(0, range=0..4)
number_slider_4 = Slider(0.6, range=0..4)
number_slider_5 = Slider(0.4, range=0..1)
panel_3 = Panel("True")

# ---- group: Daylight grid parameters
number_slider_6 = Slider(0.2, range=0.2..3)
panel_4 = Panel("0.85")

# ---- group: Write simulation data
toggle = BooleanToggle(False)

# ----
importepw = LBImportEPW(epw_file=downloadepw.epw_file)  # -> location, dry_bulb_temperature, dew_point_temperature, relative_humidity, wind_speed, wind_direction, direct_normal_rad, diffuse_horizontal_rad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; plug-in component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
brep_3 = Brep(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)

# ---- group: Selected context
data = Data()

# ---- group: Selected geometry
data_2 = Data(brep_3)

# ----
typelimit = HBTypeLimit(name="Activity_TypeLimit", low_limit="0", discrete="True", unit_type="ActivityLevel")  # -> report, type_limit; plug-in component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
constantschedule = HBConstantSchedule(values="108", type_limit=typelimit.type_limit)  # -> report, schedule, idf_text; plug-in component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

python = GhPythonScript(epw_in=panel, write=toggle)  # -> out, epw_out
# ---------- python: Python ----------
__author__ = "Pedersen_Admin"
__version__ = "2021.04.26"

import rhinoscriptsyntax as rs

if write:
    epw_out = epw_in
# ---------- end python ----------
# EnergyPlus and Radiance comparison
panel_7 = Panel("")

downloadepw_2 = LBDownloadWeather(weather_URL=python.epw_out, folder=should_not_contain_whitespace)  # -> epw_file, stat_file, ddy_file; plug-in component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
importepw_2 = LBImportEPW(epw_file=downloadepw_2.epw_file)  # -> location, dry_bulb_temperature, dew_point_temperature, relative_humidity, wind_speed, wind_direction, direct_normal_rad, diffuse_horizontal_rad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; plug-in component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
panel_8 = Panel(downloadepw_2.epw_file)
xdata = LBDeconstructData(data=importepw_2.dry_bulb_temperature)  # -> header, values; plug-in component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

opaquemod = HBOpaqueModifier(name="Floor_rad_mat", reflect="0.2", spec="0", rough="0")  # -> modifier; plug-in component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
opaquemod_2 = HBOpaqueModifier(name="Ceiling_rad_mat", reflect="0.8", spec="0", rough="0")  # -> modifier; plug-in component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
opaquemod_3 = HBOpaqueModifier(name="Wall_rad_mat", reflect="0.5", spec="0", rough="0")  # -> modifier; plug-in component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
# Radiance modifiers
exteriorsubset = HBExteriorModifierSubset(exterior_wall=opaquemod_3, exterior_roof=opaquemod_2, exposed_floor=opaquemod)  # -> exterior_set; plug-in component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
interiorsubset = HBInteriorModifierSubset(interior_wall=opaquemod_3, ceiling=opaquemod_2, interior_floor=opaquemod)  # -> interior_set; plug-in component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

# ---- group: Exterior wall construction
searchconstrs = HBSearchConstructions()  # -> opaque_constrs, window_constrs, shade_constrs; plug-in component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
item = ListItem(List=searchconstrs.opaque_constrs, Index=Slider(76, range=0..201), Wrap=True)
panel_9 = Panel(searchconstrs.opaque_constrs)
decnstrconstr = HBDeconstructConstruction(constr=item)  # -> materials, layers, r_val_si, r_val_ip, u_fac_si, u_fac_ip, t_sol, t_vis; plug-in component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
panel_10 = Panel(item)
layers = Panel(decnstrconstr.layers)
u_value = Panel(decnstrconstr.u_fac_si)

# ----
python_2 = GhPythonScript(sim_folder=should_not_contain_whitespace, theta__e=xdata.values, dump=toggle)  # -> out, a; inputs theta__e: list
# ---------- python_2: Python ----------
__author__ = "Pedersen_Admin"
__version__ = "2021.04.22"

import rhinoscriptsyntax as rs
import pickle

if dump:
    output_filename = sim_folder + "\\ISO13790\\theta__e.pkl"
    with open(output_filename, "wb") as outfile:
        pickle.dump(theta__e, outfile)
# ---------- end python_2 ----------
simoutput = HBSimulationOutput(
    zone_energy_use="True",
    hvac_energy_use="True",
    gains_and_losses="True",
    comfort_metrics="True",
    surface_temperature="True",
    surface_energy_flow="True")  # -> report, sim_output; plug-in component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
shadowcalc = HBShadowCalculation(update_method="Timestep")  # -> shadow_calc; plug-in component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

# ---- group: Context
opaquemod_4 = HBOpaqueModifier(name="Context_rad_mat", reflect="0.2", spec="0", rough="0")  # -> modifier; plug-in component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
shade = HBShade(geo=data, rad_mod=opaquemod_4)  # -> report, shades; plug-in component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

# ----
# Zone Windows Total Heat Gain Energy
# Zone Windows Total Heat Loss Energy
panel_11 = Panel("""Surface Outside Face Incident Solar Radiation Rate per Area
Surface Outside Face Incident Beam Solar Radiation Rate per Area
Surface Outside Face Incident Sky Diffuse Solar Radiation Rate per Area
Surface Outside Face Incident Ground Diffuse Solar Radiation Rate per Area
Surface Window Transmitted Solar Radiation Rate
Surface Window Transmitted Solar Radiation Energy
Surface Inside Face Solar Radiation Heat Gain Rate per Area
Surface Window System Solar Transmittance
Surface Outside Face Beam Solar Incident Angle Cosine Value
Zone Lights Total Heating Energy
Zone Electric Equipment Total Heating Energy
Zone Windows Total Heat Gain Energy
Zone Windows Total Heat Loss Energy""")
customoutput = HBCustomSimulationOutput(base_sim_output=simoutput.sim_output, output_names=panel_11)  # -> report, sim_output; plug-in component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

division = Division(A="1", B=u_value)
r_si = Panel("0.13")
subtraction = Subtraction(A=division, B=r_si)
r_tot = Panel(division)
division_2 = Division(A="1", B=subtraction)
u_wall_without_r_si = Panel(division_2)

# ---- group: Windows by ratio
roomsolid = HBRoomFromSolid(geo=flatten(data_2), conditioned=True)  # -> report, rooms; plug-in component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
aperturesbyratio = HBAperturesByRatio(
    hb_objs=flatten(roomsolid.rooms),
    ratio=number_slider_5,
    subdivide=panel_3,
    win_height=number_slider,
    sill_height=number_slider_4,
    horiz_separ=number_slider_2,
    vert_separ=number_slider_3)  # -> report, hb_objs; plug-in component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
preview_rooms = Panel(aperturesbyratio.hb_objs)

# ----
simpar = HBSimulationParameter(output=customoutput.sim_output, timestep=6, shadow_calc=shadowcalc)  # -> sim_par; plug-in component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

# ---- group: Window input from LBNL WINDOW
# Construction and materials
u_value_2 = Panel("1.471")
shgc = Panel("0.613")
tvis = Panel("0.810")

# ----
windowmat = HBWindowMaterial(u_factor=u_value_2, shgc=shgc, t_vis=tvis)  # -> mat; plug-in component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
windowconstr = HBWindowConstruction(materials=windowmat)  # -> constr; plug-in component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
subfacesubset = HBSubfaceSubset(window=windowconstr)  # -> subface_set; plug-in component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
exteriorsubset_2 = HBExteriorConstructionSubset(exterior_wall=item)  # -> exterior_set; plug-in component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
constructionset = HBConstructionSet(exterior_subset=exteriorsubset_2, subface_subset=subfacesubset)  # -> constr_set; plug-in component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

sqrt = SquareRoot(Value=shgc)

glassmod = HBGlassModifier(name="Glass_rad_mat_energy", trans=shgc)  # -> modifier; plug-in component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
subfacesubset_2 = HBSubfaceModifierSubset(window=glassmod)  # -> subface_set; plug-in component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
modifierset = HBModifierSet(exterior_subset=exteriorsubset, interior_subset=interiorsubset, subface_subset=subfacesubset_2)  # -> mod_set; plug-in component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

glassmod_2 = HBGlassModifier(name="Glass_rad_mat_daylight", trans=tvis)  # -> modifier; plug-in component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
subfacesubset_3 = HBSubfaceModifierSubset(window=glassmod_2)  # -> subface_set; plug-in component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
modifierset_2 = HBModifierSet(exterior_subset=exteriorsubset, interior_subset=interiorsubset, subface_subset=subfacesubset_3)  # -> mod_set; plug-in component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

applymodset = HBApplyModifierSet(rooms=aperturesbyratio.hb_objs, mod_set=modifierset_2)  # -> rooms; plug-in component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
applyconstrset = HBApplyConstructionSet(rooms=applymodset, constr_set=constructionset)  # -> rooms; plug-in component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

adiabaticbytype = HBAdiabaticByType(
    hb_objs=flatten(applyconstrset),
    exterior_walls="False",
    roofs="True",
    exposed_floors="True",
    interior_walls="True",
    interior_floors="True")  # -> hb_objs; plug-in component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

python_3 = GhPythonScript()  # -> occ_sch
# ---------- python_3: Python ----------
__author__ = "Pedersen_Admin"
__version__ = "2021.05.04"

import rhinoscriptsyntax as rs

occ_sch = []
weekday = [0]*8 + [1]*9 + [0]*7
weekendday = [0]*24
for i in range(52):
    for j in range(5):
        occ_sch.extend(weekday)
    for j in range(2):
        occ_sch.extend(weekendday)
occ_sch.extend(weekendday)

assert len(occ_sch) == 8760
# ---------- end python_3 ----------
typelimit_2 = HBTypeLimit(name="Setpoints_TypeLimits", unit_type="Temperature")  # -> report, type_limit; plug-in component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
fixedintervalschedule = HBFixedIntervalSchedule(values=python_3)  # -> report, schedule; plug-in component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
constantschedule_2 = HBConstantSchedule(values="1")  # -> report, schedule, idf_text; plug-in component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
constantschedule_3 = HBConstantSchedule(values="26", type_limit=typelimit_2.type_limit)  # -> report, schedule, idf_text; plug-in component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
constantschedule_4 = HBConstantSchedule(values="20", type_limit=typelimit_2.type_limit)  # -> report, schedule, idf_text; plug-in component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
division_3 = Division(A="1", B="15")
setpoint = HBSetpoint(name="Setpoints", heating_sch=constantschedule_4.schedule, cooling_sch=constantschedule_3.schedule)  # -> setpoint; plug-in component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
infiltration = HBInfiltration(name="Infiltration", flow_per_ext_area="0.0001", schedule=constantschedule_2.schedule)  # -> infil; plug-in component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
ventilation = HBVentilation(name="Ventilation", flow_per_area="0.0012", schedule=fixedintervalschedule.schedule)  # -> vent; plug-in component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
people = HBPeople(
    name="People_Load",
    ppl_per_area=division_3,
    occupancy_sch=fixedintervalschedule.schedule,
    activity_sch=constantschedule.schedule)  # -> people; plug-in component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
lighting = HBLighting(name="Lighting_Load", watts_per_area="5", schedule=fixedintervalschedule.schedule)  # -> lighting; plug-in component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
equipment = HBEquipment(name="Equipment_Load", watts_per_area="5", schedule=fixedintervalschedule.schedule)  # -> equip; plug-in component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
programtype = HBProgramType(
    name="Comparison_program",
    people=people,
    lighting=lighting,
    electric_equip=equipment,
    infiltration=infiltration,
    ventilation=ventilation,
    setpoint=setpoint)  # -> program; plug-in component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
applyprogram = HBApplyProgramType(rooms=flatten(adiabaticbytype), program=programtype)  # -> report, rooms; plug-in component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

panel_12 = Panel(sqrt)

idealair = HBIdealAir(
    rooms=flatten(applyprogram.rooms),
    economizer="NoEconomizer",
    sensible_hr="0",
    latent_hr="0",
    heat_limit="NoLimit",
    cool_limit="NoLimit")  # -> report, rooms; plug-in component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

panel_13 = Panel(glassmod)
model = HBModel(rooms=flatten(idealair.rooms), name="Comparison")  # -> report, model; plug-in component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

vizbytype = HBVisualizeByType(hb_objs=model.model)  # -> walls, interior_walls, roofs, ceilings, exterior_floors, interior_floors, air_walls, apertures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; plug-in component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
data_3 = Data(vizbytype.roofs)

gridrooms = HBSensorGridFromRooms(rooms=applymodset, grid_size=number_slider_6, dist_floor=panel_4)  # -> grid, points, mesh; plug-in component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

facen = FaceNormals(Mesh=gridrooms.mesh)  # -> Centers, Normals
vdis = VectorDisplay(Anchor=facen.Centers, Vector=facen.Normals)

division_4 = Division(A="1", B=u_value_2)
r_si_2 = Panel("0.13")
subtraction_2 = Subtraction(A=division_4, B=r_si_2)
r_tot_2 = Panel(division_4)
division_5 = Division(A="1", B=subtraction_2)
u_window_without_r_si = Panel(division_5)

flatten = FlattenTree(Tree=gridrooms.points, Path="{0}")
assigngridsviews = HBAssignGridsAndViews(model=model.model, grids=flatten(gridrooms.grid))  # -> model; plug-in component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
lng = ListLength(List=flatten)
daylight = Panel(lng)

item_2 = ListItem(List=panel_11, Index="0", Wrap=True)
panel_14 = Panel(item_2)
applymodset_2 = HBApplyModifierSet(rooms=aperturesbyratio.hb_objs, mod_set=modifierset)  # -> rooms; plug-in component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

pt = ConstructPoint(XCoordinate="450", YCoordinate="0", ZCoordinate="0")

hourlyplot = LBHourlyPlot(data=importepw.dry_bulb_temperature, base_pt=pt)  # -> report, mesh, legend, borders, labels, title; plug-in component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

# ---- group: Applying Radiance modifiers to rooms
# Daylight - raytracing
applymodset_3 = HBApplyModifierSet(rooms=aperturesbyratio.hb_objs, mod_set=modifierset_2)  # -> rooms; plug-in component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
model_2 = HBModel(rooms=flatten(applymodset_3), name="Daylight")  # -> report, model; plug-in component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

# ----
model_3 = HBModel(rooms=flatten(applymodset_2), name="Energy_outside")  # -> report, model; plug-in component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

# ----
# Energy - raytracing preparation
model_4 = HBModel(rooms=flatten(applymodset_2), name="Energy_inside")  # -> report, model; plug-in component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

panel_15 = Panel("""4
5
6
7
8
9
10
11
12
13
14
15
16
17
18
19
20
21""")

# ---- group: Generate grid in front of every window
python_4 = GhPythonScript(rooms=aperturesbyratio.hb_objs, grid_size="8", dist_window="0.1")  # -> grid, points, mesh, normals; inputs rooms: list
# ---------- python_4: Python ----------
__author__ = "Pedersen_Admin"
__version__ = "2021.04.19"

import rhinoscriptsyntax as rs
try:  # import the honeybee-radiance dependencies
    from honeybee_radiance.sensorgrid import SensorGrid
    from ladybug_rhino.fromgeometry import from_mesh3d, from_point3d
except ImportError as e:
    raise ImportError('\nFailed to import honeybee_radiance:\n\t{}'.format(e))


grid = []
points = []
mesh = []
normals = []
count = 0
for room in _rooms:
    for face in room.faces:
        for aperture in face.apertures:
            s_grid = SensorGrid.from_face3d(
            aperture.identifier + "_SensorGrid",
            [aperture.geometry],
            x_dim = float(_grid_size), 
            y_dim=None,
            offset = float(_dist_window))
            
            grid.append(s_grid)
            mesh.append(from_mesh3d(s_grid.mesh))
            points.extend(list(s_grid.mesh.face_centroids))
            normals.extend(list(s_grid.mesh.face_normals))
# ---------- end python_4 ----------

# ---- group: Generate grid behind every window
python_5 = GhPythonScript(rooms=aperturesbyratio.hb_objs, grid_size="8", dist_window="0.1")  # -> grid, points, mesh, normals; inputs rooms: list
# ---------- python_5: Python ----------
__author__ = "Pedersen_Admin"
__version__ = "2021.04.19"

import rhinoscriptsyntax as rs
try:  # import the honeybee-radiance dependencies
    from honeybee_radiance.sensorgrid import SensorGrid
    from ladybug_rhino.fromgeometry import from_mesh3d, from_point3d
except ImportError as e:
    raise ImportError('\nFailed to import honeybee_radiance:\n\t{}'.format(e))


grid = []
points = []
mesh = []
normals = []
count = 0
for room in _rooms:
    for face in room.faces:
        for aperture in face.apertures:
            s_grid = SensorGrid.from_face3d(
            aperture.identifier + "_SensorGrid",
            [aperture.geometry],
            x_dim = float(_grid_size), 
            y_dim=None,
            offset = -float(_dist_window))
            
            grid.append(s_grid)
            mesh.append(from_mesh3d(s_grid.mesh))
            points.extend(list(s_grid.mesh.face_centroids))
            normals.extend(list(s_grid.mesh.face_normals))
# ---------- end python_5 ----------

# ----
concat = Concatenate(FragmentA=should_not_contain_whitespace, FragmentB="\ISO13790")
concat_2 = Concatenate(FragmentA=concat, FragmentB="\rooms_info.pkl")

# ----
# -ab 3 -ad 5000 -lw 2e-4
# -ab 7 -ad 25000 -lw 4e-5
downloadepw_3 = LBDownloadWeather(weather_URL=panel)  # -> epw_file, stat_file, ddy_file; plug-in component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
wea = HBWeaFromEPW(epw_file=downloadepw_3.epw_file)  # -> wea; plug-in component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
recipesettings = HBRecipeSettings(workers="10", reload_old=False)  # -> settings; plug-in component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
annualdaylight = HBAnnualDaylight(
    model=assigngridsviews,
    wea=wea,
    schedule=fixedintervalschedule.schedule,
    radiance_par="-ab 10 -ad 1e5 -lw 1e-5",
    run_settings=recipesettings,
    run=Toggle(False))  # -> report, results, DA, cDA, UDI, UDI_low, UDI_up; plug-in component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

modeltoosm = HBModelToOSM(model=model.model, epw_file=downloadepw_3.epw_file, sim_par=simpar, write=Toggle(False), run=Toggle(False))  # -> report, jsons, osw, osm, idf, sql, zsz, rdd, html; plug-in component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

readrdd = HBReadResultDictionary(rdd=modeltoosm.rdd, keywords="surface")  # -> outputs; plug-in component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
item_3 = ListItem(List=readrdd, Index="62", Wrap=True)
panel_16 = Panel(item_3)
panel_17 = Panel(readrdd)

faceresult = HBReadFaceResult(sql=modeltoosm.sql)  # -> face_indoor_temp, face_outdoor_temp, face_energy_flow; plug-in component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
roomcomfortresult = HBReadRoomComfortResult(sql=modeltoosm.sql)  # -> oper_temp, air_temp, rad_temp, rel_humidity; plug-in component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
roomenergyresult = HBReadRoomEnergyResult(sql=modeltoosm.sql)  # -> cooling, heating, lighting, electric_equip, gas_equip, hot_water, fan_electric, pump_electric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; plug-in component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
hourlyplot_2 = LBHourlyPlot(data=roomenergyresult.solar_gain, base_pt=pt)  # -> report, mesh, legend, borders, labels, title; plug-in component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

facen_2 = FaceNormals(Mesh=python_4.mesh)  # -> Centers, Normals
vdis_2 = VectorDisplay(Anchor=facen_2.Centers, Vector=facen_2.Normals)

facen_3 = FaceNormals(Mesh=python_5.mesh)  # -> Centers, Normals
vdis_3 = VectorDisplay(Anchor=facen_3.Centers, Vector=facen_3.Normals)

explode = MeshExplode(Mesh=python_5.mesh, Interpolate=False)
customresult = HBReadCustomResult(sql=modeltoosm.sql, output_names=panel_14)  # -> results; plug-in component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

# ---- group: Surface Window Transmitted Solar Radiation Energy
panel_18 = Panel(customresult)
split = SplitList(List=customresult, Index="16")  # -> ListA, ListB
xdata_2 = LBDeconstructData(data=split.ListB)  # -> header, values; plug-in component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
xdata_3 = LBDeconstructData(data=split.ListA)  # -> header, values; plug-in component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
panel_19 = Panel(xdata_2.values)
panel_20 = Panel(xdata_3.values)

# ----
item_4 = ListItem(List=customresult, Index=panel_15, Wrap=True)
area = MeshArea(Mesh=explode)  # -> Area, Centroid

# ---- group: Vizualizing/preview of model
vizbytype_2 = HBVisualizeByType(hb_objs=model_2.model)  # -> walls, interior_walls, roofs, ceilings, exterior_floors, interior_floors, air_walls, apertures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; plug-in component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

# ----
data_4 = Data(vizbytype_2.apertures)
facen_4 = FaceNormals(Mesh=data_4)  # -> Centers, Normals
explode_2 = MeshExplode(Mesh=data_4, Interpolate=False)
multiplication = Multiplication(A=facen_4.Normals, B="-0.01")
move = Move(Geometry=explode_2, Motion=multiplication)  # -> Geometry, Transform

face = HBFace(geo=move.Geometry, name="Extra_windows_inside", rad_mod=glassmod)  # -> report, faces; plug-in component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
gridrooms_2 = HBSensorGridFromRooms(rooms=applymodset_3, grid_size=number_slider_6, dist_floor=panel_4)  # -> grid, points, mesh; plug-in component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
python_6 = GhPythonScript(
    rooms=aperturesbyratio.hb_objs,
    energy_mesh_areas=area.Area,
    U__wall=division_2,
    U__window=division_5,
    output_folder=concat,
    output_filename=concat_2,
    dump=toggle)  # -> out; inputs rooms: list, energy_mesh_areas: tree
# ---------- python_6: Python ----------
__author__ = "Pedersen_Admin"
__version__ = "2021.04.19"

import rhinoscriptsyntax as rs
import pickle
import os

rooms = []
aperture_count = 0 
for i, room in enumerate(_rooms):
    name = room.identifier
    exposed_area = room.exterior_wall_area
    floor_area = room.floor_area
    ext_wall_area = room.exterior_wall_area - room.exterior_aperture_area
    aperture_area = room.exterior_aperture_area

    H__tr_op = ext_wall_area*U__wall
    H__tr_w = aperture_area*float(U__window)
    
    aperture_identifiers_list = []
    aperture_areas_list = []
    room_aperture_mesh_face_count = 0
    for j, face in enumerate(room.faces):
        for k, aperture in enumerate(face.apertures):
            aperture_identifiers_list.append(aperture.identifier)
            #print(list(energy_mesh_areas.Branches[aperture_count]))
            aperture_areas_list.append(list(energy_mesh_areas.Branches[aperture_count]))
            room_aperture_mesh_face_count += len(list(energy_mesh_areas.Branches[aperture_count]))
            aperture_count += 1
    
    
    
    a = {"name": name,
    "A__f": floor_area, 
    "H__tr_op": H__tr_op,
    "H__tr_w": H__tr_w,
    "U__wall": U__wall,
    "U__window": float(U__window),
    "exposed_area": exposed_area, 
    "aperture_identifiers_list": aperture_identifiers_list,
    "aperture_areas_list": aperture_areas_list,
    "room_aperture_mesh_face_count": room_aperture_mesh_face_count}
    
    rooms.append(a)


if dump:
    if not os.path.exists(output_folder):
        os.makedirs(output_folder)
    with open(output_filename, "wb") as outfile:
        pickle.dump(rooms, outfile, protocol=2)
# ---------- end python_6 ----------

flatten_2 = FlattenTree(Tree=python_5.points, Path="{0}")
assigngridsviews_2 = HBAssignGridsAndViews(model=model_4.model, grids=flatten(python_5.grid))  # -> model; plug-in component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
lng_2 = ListLength(List=flatten_2)
energy = Panel(lng_2)

flatten_3 = FlattenTree(Tree=python_4.points, Path="{0}")
assigngridsviews_3 = HBAssignGridsAndViews(model=model_3.model, grids=flatten(python_4.grid))  # -> model; plug-in component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
lng_3 = ListLength(List=flatten_3)
energy_2 = Panel(lng_3)

panel_21 = Panel(annualdaylight.report)

flatten_4 = FlattenTree(Tree=annualdaylight.DA, Path="{0}")
python_7 = GhPythonScript(da_list=flatten_4)  # -> out, minimum, maximum; inputs da_list: list
# ---------- python_7: Python ----------
__author__ = "Pedersen_Admin"
__version__ = "2021.04.21"

import rhinoscriptsyntax as rs

try:
    minimum = min(da_list)
    maximum = max(da_list)
except:
    pass
# ---------- end python_7 ----------
legendpar = LBLegendParameters(min=python_7.minimum, max=python_7.maximum)  # -> leg_par; plug-in component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
heatmap = LBSpatialHeatmap(values=annualdaylight.DA, mesh=gridrooms.mesh, legend_par=legendpar)  # -> mesh, legend, title, colors, legend_par; plug-in component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
bang = ExplodeTree(Data=heatmap.legend)
mesh = Mesh(heatmap.mesh)

flatten_5 = FlattenTree(Tree=gridrooms_2.points, Path="{0}")
assigngridsviews_4 = HBAssignGridsAndViews(model=model_2.model, grids=flatten(gridrooms_2.grid))  # -> model; plug-in component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
lng_4 = ListLength(List=flatten_5)
daylight_2 = Panel(lng_4)

panel_22 = Panel(gridrooms_2.mesh)
panel_23 = Panel(area.Area)

facen_5 = FaceNormals(Mesh=gridrooms_2.mesh)  # -> Centers, Normals
vdis_4 = VectorDisplay(Anchor=facen_5.Centers, Vector=facen_5.Normals)

hourlyplot_3 = LBHourlyPlot(data=item_4, base_pt=pt)  # -> report, mesh, legend, borders, labels, title; plug-in component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

concat_3 = Concatenate(FragmentA=should_not_contain_whitespace, FragmentB="\info.pkl")

concat_4 = Concatenate(FragmentA=should_not_contain_whitespace, FragmentB="\Raytracing")
modeltorad = HBModelToRadFolder(model=[assigngridsviews_4, assigngridsviews_2, assigngridsviews_3], folder=concat_4, write=toggle)  # -> report, folder; plug-in component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

python_8 = GhPythonScript(
    epw_file=panel_8,
    no_daylight_sensorpoints=daylight_2,
    no_energy_inside_sensorpoints=energy,
    no_energy_outside_sensorpoints=energy_2,
    output_filename=concat_3,
    dump=toggle)  # -> out, a
# ---------- python_8: Python ----------
__author__ = "Pedersen_Admin"
__version__ = "2021.04.26"

import rhinoscriptsyntax as rs
import pickle
import os

a = {"epw_file": epw_file,
    "no_daylight_sensorpoints": no_daylight_sensorpoints,
    "no_energy_inside_sensorpoints": no_energy_inside_sensorpoints,
    "no_energy_outside_sensorpoints": no_energy_outside_sensorpoints}

if dump:
    with open(output_filename, "wb") as outfile:
        pickle.dump(a, outfile, protocol=2)
# ---------- end python_8 ----------
constrheader = LBConstructHeader(data_type="Energy")  # -> header; plug-in component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
constrheader_2 = LBConstructHeader(data_type="Energy")  # -> header; plug-in component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
python_9 = GhPythonScript(x=xdata_3.values, y=xdata_2.values)  # -> out, x_out, y_out; inputs x: tree, y: tree
# ---------- python_9: Python ----------
__author__ = "Pedersen_Admin"
__version__ = "2021.05.20"

import rhinoscriptsyntax as rs
import ghpythonlib.treehelpers as th

x_out = []
lst = th.tree_to_list(x)[0][0]
for i in range(8760):
    number = 0
    for j in range(len(lst)):
        number += lst[j][i]
    x_out.append(number)

y_out = []
lst = th.tree_to_list(y)[0][0]
for i in range(8760):
    number = 0
    for j in range(len(lst)):
        number += lst[j][i]
    y_out.append(number)
# ---------- end python_9 ----------
data_5 = LBConstructData(header=constrheader, values=python_9.y_out)  # -> data; plug-in component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
data_6 = LBConstructData(header=constrheader_2, values=python_9.x_out)  # -> data; plug-in component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
hourlyplot_4 = LBHourlyPlot(data=[data_6, data_5], base_pt=pt)  # -> report, mesh, legend, borders, labels, title; plug-in component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

# ---- group: DA
python_10 = GhPythonScript(sim_folder=should_not_contain_whitespace, rooms_ordering=aperturesbyratio.hb_objs)  # -> out, DA; inputs rooms_ordering: list
# ---------- python_10: Python ----------
__author__ = "Pedersen_Admin"
__version__ = "2021.04.21"

import cPickle as pickle
import rhinoscriptsyntax as rs

try:
    #print(pickle.HIGHEST_PROTOCOL) #Highest protocol is 2
    DA = []
    for room in rooms_ordering:
        identifier = room.identifier
        identifier_split = identifier.split("_")
        name = identifier_split[0] + "_" + identifier_split[1]
        file = name + ".pkl"
        path = sim_folder + "\\output\\da\\" + file
        with open(path, 'rb') as pkl_file:
            DA.append(pickle.load(pkl_file))
except:
    pass
# ---------- end python_10 ----------
# Display DA output
panel_25 = Panel(python_10.DA)
listtotree = ListToTree(PythonList=python_10.DA)  # -> DataTree; inputs PythonList: list, BasePath: list of Int32
# ---------- listtotree: Python ----------
from Grasshopper import DataTree as Tree
from Grasshopper.Kernel.Data import GH_Path as Path
from System import Array

def list_to_tree(input, none_and_holes=False, base_path=[0]):
    """Transforms nestings of lists or tuples to a Grasshopper DataTree"""
    
    def process_one_item(input,tree,track):
        path = Path(Array[int](track))
        if len(input) == 0 and none_and_holes: tree.EnsurePath(path); return
        for i,item in enumerate(input):
            if hasattr(item, '__iter__'): #if list or tuple
                track.append(i); process_one_item(item,tree,track); track.pop()
            else:
                if none_and_holes: tree.Insert(item,path,i)
                elif item is not None: tree.Add(item,path)
    tree = Tree[object]()
    if input is not None: process_one_item(input,tree,base_path[:]); return tree
    

pythonList = PythonList or []
None_and_holes = False
Base_path = BasePath or [0]


DataTree = list_to_tree(pythonList,none_and_holes = None_and_holes, base_path= Base_path)
# ---------- end listtotree ----------
flatten_6 = FlattenTree(Tree=listtotree, Path="{0}")
python_11 = GhPythonScript(da_list=flatten_6)  # -> out, minimum, maximum; inputs da_list: list; same code as python_7
legendpar_2 = LBLegendParameters(min=python_11.minimum, max=python_11.maximum)  # -> leg_par; plug-in component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
graft = GraftTree(Tree=gridrooms_2.mesh, IncludeEmptyLists=True, IncludeNullItems=True)
panel_26 = Panel(listtotree)
heatmap_2 = LBSpatialHeatmap(values=listtotree, mesh=graft, legend_par=legendpar_2)  # -> mesh, legend, title, colors, legend_par; plug-in component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

# ----
# Display ISO13790 output
python_12 = GhPythonScript(rooms=aperturesbyratio.hb_objs, sim_folder=should_not_contain_whitespace)  # -> out, hc_load_hourly, c_load_hourly, h_load_hourly, theta__air, theta__op, Phi__sol, aperture_names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; inputs rooms: list
# ---------- python_12: Python ----------
__author__ = "Pedersen_Admin"
__version__ = "2021.04.29"

import rhinoscriptsyntax as rs
import cPickle as pickle
import sys


output_folder = sim_folder + "\\output\\ISO13790"
hc_load_hourly = []
c_load_hourly = []
h_load_hourly = []
theta__air = []
theta__op = []
Phi__sol = []
aperture_names = []
Phi_aperture = []
Phi_aperture_outside = []
infil_HC = []
venti_HC = []
windows_HC = []
walls_HC = []
Phi__int_people = []
Phi__int_equip = []
Phi__int_light = []

for room in rooms:
    name = room.identifier
    
    #Room specific output
    file = output_folder + "\\{}__hc_load_hourly.pkl".format(name)
    with open(file, 'rb') as pkl_file:
        hc_load_hourly.append(pickle.load(pkl_file))
        
    file = output_folder + "\\{}__c_load_hourly.pkl".format(name)
    with open(file, 'rb') as pkl_file:
        c_load_hourly.append(pickle.load(pkl_file))
    
    file = output_folder + "\\{}__h_load_hourly.pkl".format(name)
    with open(file, 'rb') as pkl_file:
        h_load_hourly.append(pickle.load(pkl_file))
    
    file = output_folder + "\\{}__theta__air.pkl".format(name)
    with open(file, 'rb') as pkl_file:
        theta__air.append(pickle.load(pkl_file))
    
    file = output_folder + "\\{}__theta__op.pkl".format(name)
    with open(file, 'rb') as pkl_file:
        theta__op.append(pickle.load(pkl_file))
    
    file = output_folder + "\\{}__Phi__sol.pkl".format(name)
    with open(file, 'rb') as pkl_file:
        Phi__sol.append(pickle.load(pkl_file))
    
    file = output_folder + "\\{}__infil_HC.pkl".format(name)
    with open(file, 'rb') as pkl_file:
        infil_HC.append(pickle.load(pkl_file))
    
    file = output_folder + "\\{}__venti_HC.pkl".format(name)
    with open(file, 'rb') as pkl_file:
        venti_HC.append(pickle.load(pkl_file))
    
    file = output_folder + "\\{}__windows_HC.pkl".format(name)
    with open(file, 'rb') as pkl_file:
        windows_HC.append(pickle.load(pkl_file))
    
    file = output_folder + "\\{}__walls_HC.pkl".format(name)
    with open(file, 'rb') as pkl_file:
        walls_HC.append(pickle.load(pkl_file))
    
    file = output_folder + "\\{}__Phi__int_people.pkl".format(name)
    with open(file, 'rb') as pkl_file:
        Phi__int_people.append(pickle.load(pkl_file))
    
    file = output_folder + "\\{}__Phi__int_equip.pkl".format(name)
    with open(file, 'rb') as pkl_file:
        Phi__int_equip.append(pickle.load(pkl_file))
    
    file = output_folder + "\\{}__Phi__int_light.pkl".format(name)
    with open(file, 'rb') as pkl_file:
        Phi__int_light.append(pickle.load(pkl_file))
    
    #Aperature specific output
    for face in room.faces:
        for aperture in face.apertures:
            name = aperture.identifier
            
            aperture_names.append(name)
            
            file = output_folder + "\\{}__Phi_aperture_outside.pkl".format(name)
            with open(file, 'rb') as pkl_file:
                Phi_aperture_outside.append(pickle.load(pkl_file))
            
            file = output_folder + "\\{}__Phi_aperture.pkl".format(name)
            with open(file, 'rb') as pkl_file:
                Phi_aperture.append(pickle.load(pkl_file))
# ---------- end python_12 ----------

# ----
# Hourly heating and cooling load
panel_27 = Panel("Energy")
listtotree_2 = ListToTree(PythonList=python_12.Phi_aperture_outside)  # -> DataTree; inputs PythonList: list, BasePath: list of Int32; same code as listtotree
constrheader_3 = LBConstructHeader(data_type=panel_27)  # -> header; plug-in component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
data_7 = LBConstructData(header=constrheader_3, values=listtotree_2)  # -> data; plug-in component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
flatten_7 = FlattenTree(Tree=data_7, Path="{0}")
hourlyplot_5 = LBHourlyPlot(data=flatten_7)  # -> report, mesh, legend, borders, labels, title; plug-in component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

panel_28 = Panel(python_12.aperture_names)

# ---- group: Above 50 % sDA or not
python_13 = GhPythonScript(DA=listtotree)  # -> out, DA_above_50; inputs DA: list
# ---------- python_13: Python ----------
__author__ = "Pedersen_Admin"
__version__ = "2021.04.28"

import rhinoscriptsyntax as rs

DA_above_50 = []

for i in range(len(DA)):
    if DA[i] >= 50:
        DA_above_50.append(1)
    else: 
        DA_above_50.append(0)
# ---------- end python_13 ----------
graft_2 = GraftTree(Tree=gridrooms_2.mesh, IncludeEmptyLists=True, IncludeNullItems=True)
legendpar_3 = LBLegendParameters(min="0", max="1")  # -> leg_par; plug-in component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
heatmap_3 = LBSpatialHeatmap(values=python_13.DA_above_50, mesh=graft_2, legend_par=legendpar_3)  # -> mesh, legend, title, colors, legend_par; plug-in component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

# ---- group: sDA
python_14 = GhPythonScript(DA=listtotree)  # -> out, sDA; inputs DA: list
# ---------- python_14: Python ----------
__author__ = "Pedersen_Admin"
__version__ = "2021.04.28"

import rhinoscriptsyntax as rs

try:
    sDA = 0
    for i in range(len(DA)):
        if DA[i] > 50:
            sDA += 1
            
    sDA = (sDA/len(DA))*100
except:
    pass
# ---------- end python_14 ----------
panel_29 = Panel(python_14.sDA)

# ---- group: Above 50 % sDA or not
bang_2 = ExplodeTree(Data=heatmap_3.legend)
mesh_2 = Mesh(heatmap_3.mesh)

# ---- group: DA
bang_3 = ExplodeTree(Data=heatmap_2.legend)
mesh_3 = Mesh(heatmap_2.mesh)
