# Grasshopper definition comparison_tests.gh (Grasshopper 1.0.7)
# plug-ins: MeshEdit Components

radiance_path = Panel("C:\Radiance")
accelerad_path = Panel("C:\Accelerad")

# ---- group: Run on CPU or GPU
toggle = BooleanToggle(True)
toggle_2 = BooleanToggle(False)

# ---- group: Modify batch file
modify_batch_file = GhPythonScript(run_on_CPU=toggle_2, run_on_GPU=toggle, radiance_path=radiance_path, accelerad_path=accelerad_path)  # -> out
# ---------- modify_batch_file: Python ----------
__author__ = "Tubsp"
__version__ = "2021.02.05"

import rhinoscriptsyntax as rs
import shutil
import os


#Input check
if run_on_CPU and run_on_GPU:
    raise Exception("Not possible to run on both CPU and GPU at the same time")


#Creating paths
radiance_path = radiance_path.lower()
accelerad_path = accelerad_path.lower()
radiance_backup_path = accelerad_path + "\\radiance_backup"



#Check that backup folder exists
if run_on_CPU or run_on_GPU:
    if not os.path.isdir(radiance_backup_path):
        shutil.copytree(radiance_path, radiance_backup_path)
    
    accelerad_files = [
    "accelerad_rcontrib.exe",
    "accelerad_rfluxmtx.exe",
    "accelerad_rpict.exe",
    "accelerad_rtrace.exe"]
    
    radiance_files = [
    "rcontrib.exe",
    "rfluxmtx.exe",
    "rpict.exe",
    "rtrace.exe"]
    
    radiance_backup_files = ["0", "0", "0", "0"]
    
    for i in range(len(accelerad_files)):
        accelerad_files[i] = accelerad_path + "\\bin\\" + accelerad_files[i]
        radiance_backup_files[i] = radiance_backup_path + "\\bin\\" + radiance_files[i]
        radiance_files[i] = radiance_path + "\\bin\\" + radiance_files[i]
    
    
    accelerad_support_files = []
    for root, dirs, files in os.walk(accelerad_path):
        for name in files:
            if (accelerad_path + "\\bin" in root) or (accelerad_path + "\\lib" in root):
                if not any(name in s for s in accelerad_files):
                   accelerad_support_files.append(os.path.join(root, name))
                   #print(os.path.join(root, name))
    
    
    for i in range(len(accelerad_support_files)):
        shutil.copyfile(accelerad_support_files[i],
        accelerad_support_files[i].replace(accelerad_path,radiance_path))


#Run on CPU
if run_on_CPU:
    for i in range(len(radiance_backup_files)):
        shutil.copyfile(radiance_backup_files[i],radiance_files[i])
    print("Ready to run on CPU (Radiance)")

#Run on GPU
if run_on_GPU:
    for i in range(len(accelerad_files)):
        shutil.copyfile(accelerad_files[i], radiance_files[i])
    print("Ready to run on GPU (Accelerad)")
# ---------- end modify_batch_file ----------
panel = Panel(modify_batch_file)

# ----
panel_2 = Panel("https://www.energyplus.net/weather-download/europe_wmo_region_6/DNK//DNK_Copenhagen.061800_IWEC/all")
downloadepw = LBDownloadWeather(weather_URL=panel_2)  # -> epw_file, stat_file, ddy_file; plug-in component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

# ---- group: Window input from LBNL WINDOW
u_value = Panel("1.471")
shgc = Panel("0.613")
tvis = Panel("0.810")

# ----
brep = Brep([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])
roomsolid = HBRoomFromSolid(geo=flatten(brep), conditioned=True)  # -> report, rooms; plug-in component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
aperturesbyratio = HBAperturesByRatio(hb_objs=flatten(roomsolid.rooms), ratio="0.4")  # -> report, hb_objs; plug-in component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
model = HBModel(rooms=flatten(aperturesbyratio.hb_objs))  # -> report, model; plug-in component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
vizbytype = HBVisualizeByType(hb_objs=aperturesbyratio.hb_objs)  # -> walls, interior_walls, roofs, ceilings, exterior_floors, interior_floors, air_walls, apertures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; plug-in component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
mesh = Mesh(vizbytype.apertures)

facen = FaceNormals(Mesh=mesh)  # -> Centers, Normals
explode = MeshExplode(Mesh=mesh, Interpolate=False)
multiplication = Multiplication(A=facen.Normals, B="0.05")
move = Move(Geometry=explode, Motion=multiplication)  # -> Geometry, Transform

mesh_2 = Mesh(vizbytype.walls)
mesh_3 = Mesh(vizbytype.roofs)
mesh_4 = Mesh(vizbytype.exterior_floors)
mesh_5 = Mesh(vizbytype.apertures)
hbwinsrf = HoneybeePlus_HoneybeeWindowSurface(geo=mesh_5)  # -> report, HB_win_srf; plug-in component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
hbsurface = HoneybeePlus_HoneybeeSurface(geo=[mesh_2, mesh_3, mesh_4])  # -> report, HB_srf; plug-in component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

facen_2 = FaceNormals(Mesh=mesh)  # -> Centers, Normals
explode_2 = MeshExplode(Mesh=mesh, Interpolate=False)
multiplication_2 = Multiplication(A=facen_2.Normals, B="-0.05")
move_2 = Move(Geometry=explode_2, Motion=multiplication_2)  # -> Geometry, Transform

facen_3 = FaceNormals(Mesh=move.Geometry)  # -> Centers, Normals
facen_4 = FaceNormals(Mesh=move_2.Geometry)  # -> Centers, Normals
flatten = FlattenTree(Tree=[facen_4.Centers, facen_3.Centers], Path="{0}")
flatten_2 = FlattenTree(Tree=[facen_4.Normals, facen_3.Normals], Path="{0}")

lng = ListLength(List=flatten)
analysisgrid = HoneybeePlus_AnalysisGrid(test_points=flatten, pts_vectors=flatten_2)  # -> analysis_grid; plug-in component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

wea = HoneybeePlus_WEAFromEPW(epw_file=downloadepw.epw_file)  # -> wea; plug-in component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
skymatrix = HoneybeePlus_SkyMatrix(north=0, wea=wea, density=1)  # -> skymtx; plug-in component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
annualradrecipe = HoneybeePlus_AnnualRadiationRecipe(skymtx=skymatrix, analysis_grids=analysisgrid, reuse_dmtx=False)  # -> analysis_recipe; plug-in component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

panel_3 = Panel(lng)
data = Data([hbsurface.HB_srf, hbwinsrf.HB_win_srf])
runradiance = HoneybeePlus_RunRadianceAnalysis(
    analysis_recipe=annualradrecipe,
    HB_objects=data,
    folder="c:\ladybug",
    name="untitled",
    write=Toggle(True),
    run=Toggle(True))  # -> report, legend_par, outputs; plug-in component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
python = GhPythonScript()  # -> out, a
# ---------- python: Python ----------
__author__ = "Pedersen_Admin"
__version__ = "2021.05.20"

import rhinoscriptsyntax as rs

a = []
for i in range(24):
    a.append(i)
# ---------- end python ----------
addition = Addition(A=python.a, B="24")
sensor = HoneybeePlus_SensorFromAnalysisGrid(analysis_grid=runradiance.outputs, index=addition)  # -> position, sensor; plug-in component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
sensor_2 = HoneybeePlus_SensorFromAnalysisGrid(analysis_grid=runradiance.outputs, index=python.a)  # -> position, sensor; plug-in component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
senhourlyvalues = HoneybeePlus_SensorHourlyValues(sensor=sensor.sensor)  # -> report, values; plug-in component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
senhourlyvalues_2 = HoneybeePlus_SensorHourlyValues(sensor=sensor_2.sensor)  # -> report, values; plug-in component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
# Outside
panel_4 = Panel("EnergyFlux")
# Inside
panel_5 = Panel("EnergyFlux")
constrheader = LBConstructHeader(data_type=panel_4)  # -> header; plug-in component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
constrheader_2 = LBConstructHeader(data_type=panel_5)  # -> header; plug-in component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
data_2 = LBConstructData(header=constrheader, values=senhourlyvalues.values)  # -> data; plug-in component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
data_3 = LBConstructData(header=constrheader_2, values=senhourlyvalues_2.values)  # -> data; plug-in component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
flatten_3 = FlattenTree(Tree=data_2, Path="{0}")
flatten_4 = FlattenTree(Tree=data_3, Path="{0}")
hourlyplot = LBHourlyPlot(data=flatten_3)  # -> report, mesh, legend, borders, labels, title; plug-in component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
hourlyplot_2 = LBHourlyPlot(data=flatten_4)  # -> report, mesh, legend, borders, labels, title; plug-in component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
