# Grasshopper definition comparison_tests_simple.gh (Grasshopper 1.0.7)
# plug-ins: MeshEdit Components

radiance_path = Panel("C:\Radiance")
accelerad_path = Panel("C:\Accelerad")

panel = Panel("https://www.energyplus.net/weather-download/europe_wmo_region_6/DNK//DNK_Copenhagen.061800_IWEC/all")
downloadepw = LBDownloadWeather(weather_URL=panel)  # -> epw_file, stat_file, ddy_file; plug-in component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

# ---- group: Window input from LBNL WINDOW
u_value = Panel("1.471")
shgc = Panel("0.613")
tvis = Panel("0.810")

# ---- group: Run on CPU or GPU
toggle = BooleanToggle(True)
toggle_2 = BooleanToggle(False)

# ---- group: Modify batch file
modify_batch_file = GhPythonScript(run_on_CPU=toggle_2, run_on_GPU=toggle, radiance_path=radiance_path, accelerad_path=accelerad_path)  # -> out
# ---------- modify_batch_file: Python ----------
__author__ = "Tubsp"
__version__ = "2021.02.05"

import rhinoscriptsyntax as rs
import shutil
import os


#Input check
if run_on_CPU and run_on_GPU:
    raise Exception("Not possible to run on both CPU and GPU at the same time")


#Creating paths
radiance_path = radiance_path.lower()
accelerad_path = accelerad_path.lower()
radiance_backup_path = accelerad_path + "\\radiance_backup"



#Check that backup folder exists
if run_on_CPU or run_on_GPU:
    if not os.path.isdir(radiance_backup_path):
        shutil.copytree(radiance_path, radiance_backup_path)
    
    accelerad_files = [
    "accelerad_rcontrib.exe",
    "accelerad_rfluxmtx.exe",
    "accelerad_rpict.exe",
    "accelerad_rtrace.exe"]
    
    radiance_files = [
    "rcontrib.exe",
    "rfluxmtx.exe",
    "rpict.exe",
    "rtrace.exe"]
    
    radiance_backup_files = ["0", "0", "0", "0"]
    
    for i in range(len(accelerad_files)):
        accelerad_files[i] = accelerad_path + "\\bin\\" + accelerad_files[i]
        radiance_backup_files[i] = radiance_backup_path + "\\bin\\" + radiance_files[i]
        radiance_files[i] = radiance_path + "\\bin\\" + radiance_files[i]
    
    
    accelerad_support_files = []
    for root, dirs, files in os.walk(accelerad_path):
        for name in files:
            if (accelerad_path + "\\bin" in root) or (accelerad_path + "\\lib" in root):
                if not any(name in s for s in accelerad_files):
                   accelerad_support_files.append(os.path.join(root, name))
                   #print(os.path.join(root, name))
    
    
    for i in range(len(accelerad_support_files)):
        shutil.copyfile(accelerad_support_files[i],
        accelerad_support_files[i].replace(accelerad_path,radiance_path))


#Run on CPU
if run_on_CPU:
    for i in range(len(radiance_backup_files)):
        shutil.copyfile(radiance_backup_files[i],radiance_files[i])
    print("Ready to run on CPU (Radiance)")

#Run on GPU
if run_on_GPU:
    for i in range(len(accelerad_files)):
        shutil.copyfile(accelerad_files[i], radiance_files[i])
    print("Ready to run on GPU (Accelerad)")
# ---------- end modify_batch_file ----------
panel_2 = Panel(modify_batch_file)

# ----
brep = Brep(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)
roomsolid = HBRoomFromSolid(geo=flatten(brep), conditioned=True)  # -> report, rooms; plug-in component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
aperturesbyratio = HBAperturesByRatio(hb_objs=flatten(roomsolid.rooms), ratio="0.4")  # -> report, hb_objs; plug-in component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

windowmat = HBWindowMaterial(u_factor=u_value, shgc=shgc, t_vis=tvis)  # -> mat; plug-in component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
windowconstr = HBWindowConstruction(materials=windowmat)  # -> constr; plug-in component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
subfacesubset = HBSubfaceSubset(window=windowconstr)  # -> subface_set; plug-in component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
constructionset = HBConstructionSet(subface_subset=subfacesubset)  # -> constr_set; plug-in component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
applyconstrset = HBApplyConstructionSet(rooms=aperturesbyratio.hb_objs, constr_set=constructionset)  # -> rooms; plug-in component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

panel_5 = Panel("""Surface Outside Face Incident Solar Radiation Rate per Area
Surface Outside Face Incident Beam Solar Radiation Rate per Area
Surface Outside Face Incident Sky Diffuse Solar Radiation Rate per Area
Surface Outside Face Incident Ground Diffuse Solar Radiation Rate per Area
Surface Window Transmitted Solar Radiation Rate
Surface Window Transmitted Solar Radiation Energy
Surface Inside Face Solar Radiation Heat Gain Rate per Area
Surface Window System Solar Transmittance
Surface Outside Face Beam Solar Incident Angle Cosine Value
Zone Lights Total Heating Energy
Zone Electric Equipment Total Heating Energy""")
faceattr = HBFaceAttributes({"Display Name": "display_name", "Simulation Name (Identifier)": "identifier", "Boundary Condition": "boundary_condition", "Has Parent": "has_parent", "Parent": "parent", "Area": "area", "Perimeter": "perimeter", "Face Type": "type", "Aperture Is Operable": "is_operable", "Door Is Glass": "is_glass"}, selected="Display Name")
simoutput = HBSimulationOutput()  # -> report, sim_output; plug-in component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
lablefaces = HBLabelFaces(hb_objs=flatten(aperturesbyratio.hb_objs), attribute=faceattr, sub_faces="True")  # -> label_text, base_pts, labels, wire_frame; plug-in component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
model = HBModel(rooms=flatten(applyconstrset))  # -> report, model; plug-in component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
shadowcalc = HBShadowCalculation(update_method="Timestep")  # -> shadow_calc; plug-in component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
customoutput = HBCustomSimulationOutput(base_sim_output=simoutput.sim_output, output_names=panel_5)  # -> report, sim_output; plug-in component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
vizbytype = HBVisualizeByType(hb_objs=aperturesbyratio.hb_objs)  # -> walls, interior_walls, roofs, ceilings, exterior_floors, interior_floors, air_walls, apertures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; plug-in component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

# ---- group: Working - Grid distances from window
panel_7 = Panel("0.1")

# ---- group: NOT working - Grid distances from window
# Calculation of solar heat gain using EnergyPlus
panel_8 = Panel("0.05")

# ----
explode = MeshExplode(Mesh=vizbytype.apertures, Interpolate=False)
simpar = HBSimulationParameter(output=customoutput.sim_output, timestep=6, shadow_calc=shadowcalc)  # -> sim_par; plug-in component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
data = Data(panel_7)
item = ListItem(List=explode, Index=0, Wrap=True)
multiplication = Multiplication(A="-1", B=data)
# Calculation of solar heat gain using simple 2PM
panel_9 = Panel("C:\ladybug\untitled\gridbased_radiation\result\accelerad.ill")
mesh = Mesh(item)
radglassmat = HoneybeePlus_RadianceGlassMaterial(name="SHGC", t_vis=shgc)  # -> material; plug-in component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

facen = FaceNormals(Mesh=mesh)  # -> Centers, Normals
multiplication_2 = Multiplication(A=facen.Normals, B=data)
move = Move(Geometry=mesh, Motion=multiplication_2)  # -> Geometry, Transform

mesh_2 = Mesh(vizbytype.apertures)
# Calculation of solar heat gain using Radiance/Accelerad
mesh_3 = Mesh(vizbytype.walls)
mesh_4 = Mesh(vizbytype.roofs)
mesh_5 = Mesh(vizbytype.exterior_floors)
hbwinsrf = HoneybeePlus_HoneybeeWindowSurface(geo=mesh_2, rad_mat=radglassmat)  # -> report, HB_win_srf; plug-in component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
# Honeybee [+] and Ladybug Tools 1.2.0
hbsurface = HoneybeePlus_HoneybeeSurface(geo=[mesh_3, mesh_4, mesh_5])  # -> report, HB_srf; plug-in component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

facen_2 = FaceNormals(Mesh=mesh)  # -> Centers, Normals
multiplication_3 = Multiplication(A=facen_2.Normals, B=multiplication)
move_2 = Move(Geometry=mesh, Motion=multiplication_3)  # -> Geometry, Transform

toggle_3 = BooleanToggle(True)
panel_10 = Panel(radglassmat)
modeltoosm = HBModelToOSM(model=model.model, epw_file=downloadepw.epw_file, sim_par=simpar, write=toggle_3, run=toggle_3)  # -> report, jsons, osw, osm, idf, sql, zsz, rdd, html; plug-in component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

# ----
# Inside room
panel_11 = Panel("4")
item_2 = ListItem(List=panel_5, Index=panel_11, Wrap=True)
customresult = HBReadCustomResult(sql=modeltoosm.sql, output_names=item_2)  # -> results; plug-in component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
mesh_6 = Mesh(item)
area = MeshArea(Mesh=mesh_6)  # -> Area, Centroid
item_3 = ListItem(List=customresult, Index="0", Wrap=True)
xdata = LBDeconstructData(data=item_3)  # -> header, values; plug-in component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
constrheader = LBConstructHeader(data_type="EnergyFlux")  # -> header; plug-in component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
division = Division(A=xdata.values, B=area.Area)
data_2 = LBConstructData(header=constrheader, values=division)  # -> data; plug-in component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
pt = ConstructPoint(XCoordinate=0, YCoordinate="-150", ZCoordinate=0)
hourlyplot = LBHourlyPlot(data=data_2, base_pt=pt)  # -> report, mesh, legend, borders, labels, title; plug-in component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

facen_3 = FaceNormals(Mesh=move.Geometry)  # -> Centers, Normals
facen_4 = FaceNormals(Mesh=move_2.Geometry)  # -> Centers, Normals
flatten = FlattenTree(Tree=[facen_4.Centers, facen_3.Centers], Path="{0}")
flatten_2 = FlattenTree(Tree=[facen_4.Normals, facen_3.Normals], Path="{0}")

python = GhPythonScript(path=panel_9)  # -> out, a, b
# ---------- python: Python ----------
__author__ = "Pedersen_Admin"
__version__ = "2021.05.22"

import rhinoscriptsyntax as rs


with open(path, "r") as infile:
    for i in range(11):
        print(infile.readline())
    
    a_ini = infile.readline().split("\t ")
    b_ini = infile.readline().split("\t ")

a=[]
b=[]
for i in range(8760):
    a.append(float(a_ini[i]))
    b.append(float(b_ini[i]))
# ---------- end python ----------

# ----
# Outside room
panel_12 = Panel("0")
item_4 = ListItem(List=panel_5, Index=panel_12, Wrap=True)
customresult_2 = HBReadCustomResult(sql=modeltoosm.sql, output_names=item_4)  # -> results; plug-in component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
item_5 = ListItem(List=customresult_2, Index="6", Wrap=True)
pt_2 = ConstructPoint(XCoordinate="450", YCoordinate="-150", ZCoordinate=0)
hourlyplot_2 = LBHourlyPlot(data=item_5, base_pt=pt_2)  # -> report, mesh, legend, borders, labels, title; plug-in component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

panel_13 = Panel(modeltoosm.sql)
panel_14 = Panel(python.a)
vdis = VectorDisplay(Anchor=facen_4.Centers, Vector=facen_4.Normals)
panel_15 = Panel(python.b)
readrdd = HBReadResultDictionary(rdd=modeltoosm.rdd, keywords="solar")  # -> outputs; plug-in component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
lng = ListLength(List=flatten)
analysisgrid = HoneybeePlus_AnalysisGrid(test_points=flatten, pts_vectors=flatten_2)  # -> analysis_grid; plug-in component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

wea = HoneybeePlus_WEAFromEPW(epw_file=downloadepw.epw_file)  # -> wea; plug-in component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
skymatrix = HoneybeePlus_SkyMatrix(north=0, wea=wea, density=1)  # -> skymtx; plug-in component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
annualradrecipe = HoneybeePlus_AnnualRadiationRecipe(skymtx=skymatrix, analysis_grids=analysisgrid, reuse_dmtx=False)  # -> analysis_recipe; plug-in component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

panel_16 = Panel(lng)
panel_17 = Panel(readrdd)
data_3 = Data([hbsurface.HB_srf, hbwinsrf.HB_win_srf])
toggle_4 = BooleanToggle(True)
runradiance = HoneybeePlus_RunRadianceAnalysis(analysis_recipe=annualradrecipe, HB_objects=data_3, folder="c:\ladybug", name="untitled", write=toggle_4, run=toggle_4)  # -> report, legend_par, outputs; plug-in component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
# Outside room
panel_18 = Panel("EnergyFlux")
# Inside room
panel_19 = Panel("EnergyFlux")
xdata_2 = LBDeconstructData(data=item_5)  # -> header, values; plug-in component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
panel_20 = Panel(runradiance.report)
constrheader_2 = LBConstructHeader(data_type=panel_18)  # -> header; plug-in component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
constrheader_3 = LBConstructHeader(data_type=panel_19)  # -> header; plug-in component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
sensor = HoneybeePlus_SensorFromAnalysisGrid(analysis_grid=runradiance.outputs, index="1")  # -> position, sensor; plug-in component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
panel_21 = Panel(xdata_2.header)
sensor_2 = HoneybeePlus_SensorFromAnalysisGrid(analysis_grid=runradiance.outputs, index="0")  # -> position, sensor; plug-in component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
panel_22 = Panel(xdata.header)
data_4 = LBConstructData(header=constrheader_2, values=python.b)  # -> data; plug-in component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
data_5 = LBConstructData(header=constrheader_3, values=python.a)  # -> data; plug-in component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
pt_3 = ConstructPoint(XCoordinate=0, YCoordinate="-300", ZCoordinate=0)
pt_4 = ConstructPoint(XCoordinate="450", YCoordinate="-300", ZCoordinate=0)
flatten_3 = FlattenTree(Tree=data_4, Path="{0}")
senhourlyvalues = HoneybeePlus_SensorHourlyValues(sensor=sensor.sensor)  # -> report, values; plug-in component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
senhourlyvalues_2 = HoneybeePlus_SensorHourlyValues(sensor=sensor_2.sensor)  # -> report, values; plug-in component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
flatten_4 = FlattenTree(Tree=data_5, Path="{0}")
hourlyplot_3 = LBHourlyPlot(data=flatten_3, base_pt=pt_4)  # -> report, mesh, legend, borders, labels, title; plug-in component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
hourlyplot_4 = LBHourlyPlot(data=flatten_4, base_pt=pt_3)  # -> report, mesh, legend, borders, labels, title; plug-in component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
# Outside room
panel_23 = Panel("EnergyFlux")
# Inside room
panel_24 = Panel("EnergyFlux")
constrheader_4 = LBConstructHeader(data_type=panel_23)  # -> header; plug-in component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
constrheader_5 = LBConstructHeader(data_type=panel_24)  # -> header; plug-in component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
data_6 = LBConstructData(header=constrheader_4, values=senhourlyvalues.values)  # -> data; plug-in component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
data_7 = LBConstructData(header=constrheader_5, values=senhourlyvalues_2.values)  # -> data; plug-in component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
pt_5 = ConstructPoint(XCoordinate="450", YCoordinate=0, ZCoordinate=0)
flatten_5 = FlattenTree(Tree=data_6, Path="{0}")
flatten_6 = FlattenTree(Tree=data_7, Path="{0}")
hourlyplot_5 = LBHourlyPlot(data=flatten_5, base_pt=pt_5)  # -> report, mesh, legend, borders, labels, title; plug-in component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
hourlyplot_6 = LBHourlyPlot(data=flatten_6)  # -> report, mesh, legend, borders, labels, title; plug-in component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
