# Grasshopper definition tests_load_da.gh (Grasshopper 1.0.7)
# plug-ins: Kangaroo2 Components

# ---- group: Rooms
brep = Brep([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])

# ---- group: Context
brep_2 = Brep([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])

# ----
roomsolid = HBRoomFromSolid(geo=flatten(brep), conditioned=True)  # -> report, rooms; plug-in component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
shade = HBShade(geo=brep_2)  # -> report, shades; plug-in component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
aperturesbyratio = HBAperturesByRatio(
    hb_objs=flatten(roomsolid.rooms),
    ratio=Slider(0.4, range=0..1),
    subdivide="True",
    win_height=Slider(1.2, range=0..4),
    sill_height=Slider(0.6, range=0..4),
    horiz_separ=Slider(1, range=0..4),
    vert_separ=Slider(0, range=0..4))  # -> report, hb_objs; plug-in component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
model = HBModel(rooms=flatten(aperturesbyratio.hb_objs), shades=flatten(shade.shades))  # -> report, model; plug-in component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
vizbytype = HBVisualizeByType(hb_objs=model.model)  # -> walls, interior_walls, roofs, ceilings, exterior_floors, interior_floors, air_walls, apertures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; plug-in component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

# ---- group: Initial test of setup / Test
brep_3 = Brep([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])

# ----
opaquemod = HBOpaqueModifier(name="Wall_rad_mat", reflect="0.5", spec="0", rough="0")  # -> modifier; plug-in component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
opaquemod_2 = HBOpaqueModifier(name="Floor_rad_mat", reflect="0.2", spec="0", rough="0")  # -> modifier; plug-in component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
opaquemod_3 = HBOpaqueModifier(name="Ceiling_rad_mat", reflect="0.8", spec="0", rough="0")  # -> modifier; plug-in component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
glassmod = HBGlassModifier(name="Window_rad_mat", trans="0.81")  # -> modifier; plug-in component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
opaquemod_4 = HBOpaqueModifier(name="Context_rad_mat", reflect="0.2", spec="0", rough="0")  # -> modifier; plug-in component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

# ---- group: Initial test of setup
mesh = Mesh(brep_3)
tri = Triangulate(Mesh=mesh)  # -> Mesh, Count
refine = Refine(Mesh=tri.Mesh, Level=Slider(0, range=0..5))
demesh = DeconstructMesh(Mesh=refine)  # -> Vertices, Faces, Colours, Normals
flatten = FlattenTree(Tree=demesh.Vertices, Path="{0}")
flatten_2 = FlattenTree(Tree=demesh.Faces, Path="{0}")
lng = ListLength(List=flatten)
lng_2 = ListLength(List=flatten_2)
panel = Panel(lng)
panel_2 = Panel(lng_2)

# ---- group: Floors unmodified
mesh_2 = Mesh(vizbytype.exterior_floors)

# ---- group: one option
gridrooms = HBSensorGridFromRooms(rooms=model.model, grid_size=Slider(1, range=0.01..1), dist_floor="0.5")  # -> grid, points, mesh; plug-in component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
flatten_3 = FlattenTree(Tree=gridrooms.points, Path="{0}")
lng_3 = ListLength(List=flatten_3)
panel_3 = Panel(lng_3)

# ---- group: Flip
# Control number of sensorpoints
flipm = FlipMesh(Mesh=mesh_2, VertexNormals=True, FaceNormals=True, FaceOrientation=True)

# ---- group: Move
vec = VectorXYZ(XComponent="0", YComponent="0", ZComponent="0.5")  # -> Vector, Length
move = Move(Geometry=flipm, Motion=vec.Vector)  # -> Geometry, Transform

# ----
python = GhPythonScript()  # -> out, DA
# ---------- python: Python ----------
__author__ = "Pedersen_Admin"
__version__ = "2021.05.21"


import cPickle as pickle
import rhinoscriptsyntax as rs

path = r"C:\Users\Pedersen_Admin\OneDrive - Perkins and Will\Documents\GitHub\VMT_VS\Tests_convergence\prospect2_da.pkl"
DA = []
with open(path, 'rb') as pkl_file:
    DA.append(pickle.load(pkl_file))
# ---------- end python ----------
refine_2 = Refine(Mesh=move.Geometry, Level=Slider(5, range=0..9))
mesh_3 = Mesh(refine_2)

# ---- group: DA
panel_4 = Panel(python.DA)
listtotree = ListToTree(PythonList=python.DA)  # -> DataTree; inputs PythonList: list, BasePath: list of Int32
# ---------- listtotree: Python ----------
from Grasshopper import DataTree as Tree
from Grasshopper.Kernel.Data import GH_Path as Path
from System import Array

def list_to_tree(input, none_and_holes=False, base_path=[0]):
    """Transforms nestings of lists or tuples to a Grasshopper DataTree"""
    
    def process_one_item(input,tree,track):
        path = Path(Array[int](track))
        if len(input) == 0 and none_and_holes: tree.EnsurePath(path); return
        for i,item in enumerate(input):
            if hasattr(item, '__iter__'): #if list or tuple
                track.append(i); process_one_item(item,tree,track); track.pop()
            else:
                if none_and_holes: tree.Insert(item,path,i)
                elif item is not None: tree.Add(item,path)
    tree = Tree[object]()
    if input is not None: process_one_item(input,tree,base_path[:]); return tree
    

pythonList = PythonList or []
None_and_holes = False
Base_path = BasePath or [0]


DataTree = list_to_tree(pythonList,none_and_holes = None_and_holes, base_path= Base_path)
# ---------- end listtotree ----------
flatten_4 = FlattenTree(Tree=listtotree, Path="{0}")
python_2 = GhPythonScript(da_list=flatten_4)  # -> out, minimum, maximum; inputs da_list: list
# ---------- python_2: Python ----------
__author__ = "Pedersen_Admin"
__version__ = "2021.04.21"

import rhinoscriptsyntax as rs

try:
    minimum = min(da_list)
    maximum = max(da_list)
except:
    pass
# ---------- end python_2 ----------
legendpar = LBLegendParameters(min=python_2.minimum, max=python_2.maximum)  # -> leg_par; plug-in component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
graft = GraftTree(IncludeEmptyLists=True, IncludeNullItems=True)
panel_5 = Panel(listtotree)
heatmap = LBSpatialHeatmap(values=listtotree, mesh=mesh_3, legend_par=legendpar)  # -> mesh, legend, title, colors, legend_par; plug-in component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

# ----
facen = FaceNormals(Mesh=refine_2)  # -> Centers, Normals
panel_6 = Panel(refine_2)
sensorgrid = HBSensorGrid(positions=facen.Centers, directions=facen.Normals)  # -> grid; plug-in component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
flatten_5 = FlattenTree(Tree=facen.Centers, Path="{0}")
vdis = VectorDisplay(Anchor=facen.Centers, Vector=facen.Normals)
lng_4 = ListLength(List=flatten_5)
panel_7 = Panel(lng_4)
panel_8 = Panel("C:\Users\Tubsp\OneDrive\Dokumenter\GitHub\VMT_VS\Tests_convergence")

# ---- group: DA
bang = ExplodeTree(Data=heatmap.legend)
mesh_4 = Mesh(heatmap.mesh)

# ----
panel_9 = Panel("C:\Users\Tubsp\OneDrive\Dokumenter\GitHub\VMT_VS\Tests_convergence\Triangles_3500__Points_4096\Radiance\model\aperture\aperture.rad")
panel_10 = Panel("C:\Users\Tubsp\OneDrive\Dokumenter\GitHub\VMT_VS\Tests_convergence\Triangles_3500__Points_4096\Radiance\model\scene\envelope.rad")
panel_11 = Panel("C:\Users\Tubsp\OneDrive\Dokumenter\GitHub\VMT_VS\Tests_convergence\Triangles_3500__Points_4096\Radiance\model\scene\shades.rad")
# Double check
importrad = Honeybee_ImportRad(radianceFile=panel_10)  # -> RADMaterials, RADSurfaces; disabled; plug-in component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
importrad_2 = Honeybee_ImportRad(radianceFile=panel_11)  # -> RADMaterials, RADSurfaces; disabled; plug-in component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
importrad_3 = Honeybee_ImportRad(radianceFile=panel_9)  # -> RADMaterials, RADSurfaces; disabled; plug-in component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
data = Data([importrad.RADSurfaces, importrad_2.RADSurfaces, importrad_3.RADSurfaces])
flatten_6 = FlattenTree(Tree=data, Path="{0}")
lng_5 = ListLength(List=flatten_6)
# Hourly heating and cooling load
# Hourly cooling load
# Hourly heating load
panel_12 = Panel(lng_5)

tri_2 = Triangulate(Mesh=vizbytype.walls)  # -> Mesh, Count
tri_3 = Triangulate(Mesh=vizbytype.roofs)  # -> Mesh, Count
tri_4 = Triangulate(Mesh=vizbytype.apertures)  # -> Mesh, Count
tri_5 = Triangulate(Mesh=vizbytype.exterior_floors)  # -> Mesh, Count
tri_6 = Triangulate(Mesh=vizbytype.outdoor_shades)  # -> Mesh, Count

# ----
# Control triangle subdivision
number_slider = Slider(0, range=0..5)

refine_3 = Refine(Mesh=tri_2.Mesh, Level=number_slider)
refine_4 = Refine(Mesh=tri_3.Mesh, Level=number_slider)
refine_5 = Refine(Mesh=tri_5.Mesh, Level=number_slider)
refine_6 = Refine(Mesh=tri_6.Mesh, Level=number_slider)
refine_7 = Refine(Mesh=tri_4.Mesh, Level=number_slider)
face = HBFace(geo=refine_4, name="Roofs", rad_mod=opaquemod_3)  # -> report, faces; plug-in component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
face_2 = HBFace(geo=refine_3, name="Ext_walls", rad_mod=opaquemod)  # -> report, faces; plug-in component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
face_3 = HBFace(geo=refine_5, name="Floors", rad_mod=opaquemod_2)  # -> report, faces; plug-in component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
shade_2 = HBShade(geo=refine_6, name="Shades", rad_mod=opaquemod_4)  # -> report, shades; plug-in component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
aperture = HBAperture(geo=refine_7, name="Windows", rad_mod=glassmod)  # -> report, apertures; plug-in component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

data_2 = Data([face_2.faces, face.faces, face_3.faces, aperture.apertures, shade_2.shades])
flatten_7 = FlattenTree(Tree=data_2, Path="{0}")
lng_6 = ListLength(List=flatten_7)
panel_13 = Panel(lng_6)

concat = Concatenate(
    FragmentA="Triangles",
    FragmentB="_",
    FragmentC=panel_13,
    FragmentD="__",
    FragmentE="Points",
    FragmentF="_",
    FragmentG=panel_7)
panel_14 = Panel(concat)
model_2 = HBModel(
    faces=flatten([face_2.faces, face.faces, face_3.faces]),
    shades=flatten(shade_2.shades),
    apertures=flatten(aperture.apertures),
    name=panel_14)  # -> report, model; plug-in component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
assigngridsviews = HBAssignGridsAndViews(model=model_2.model, grids=flatten(sensorgrid))  # -> model; plug-in component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
vizbytype_2 = HBVisualizeByType(hb_objs=model_2.model)  # -> walls, interior_walls, roofs, ceilings, exterior_floors, interior_floors, air_walls, apertures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; plug-in component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
modeltorad = HBModelToRadFolder(model=assigngridsviews, folder=panel_8, write=Toggle(False))  # -> report, folder; plug-in component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
