# Grasshopper definition geometry.gh (Grasshopper 1.0.7)

# ---- group: This is created for LBT version 1.2.0
# Inputs
panel = Panel("1.2.0")
versioner = LBVersioner(update=Toggle(False), version=panel)  # -> Vviiiiiz; plug-in component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

# ---- group: Window parameters
number_slider = Slider(1.2, range=0..4)
number_slider_2 = Slider(1, range=0..4)
number_slider_3 = Slider(0, range=0..4)
number_slider_4 = Slider(0.6, range=0..4)
number_slider_5 = Slider(0.4, range=0..1)
panel_2 = Panel("True")

# ---- group: Daylight grid parameters
number_slider_6 = Slider(0.2, range=0.2..3)
panel_3 = Panel("0.85")

# ---- group: Rooms
brep = Brep(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)

# ---- group: Selected geometry
data = Data(brep)

# ----
opaquemod = HBOpaqueModifier(name="Floor_rad_mat", reflect="0.2", spec="0", rough="0")  # -> modifier; plug-in component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
opaquemod_2 = HBOpaqueModifier(name="Wall_rad_mat", reflect="0.5", spec="0", rough="0")  # -> modifier; plug-in component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
opaquemod_3 = HBOpaqueModifier(name="Ceiling_rad_mat", reflect="0.8", spec="0", rough="0")  # -> modifier; plug-in component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
# Radiance modifiers
exteriorsubset = HBExteriorModifierSubset(exterior_wall=opaquemod_2, exterior_roof=opaquemod_3, exposed_floor=opaquemod)  # -> exterior_set; plug-in component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
interiorsubset = HBInteriorModifierSubset(interior_wall=opaquemod_2, ceiling=opaquemod_3, interior_floor=opaquemod)  # -> interior_set; plug-in component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

# ---- group: Windows by ratio
roomsolid = HBRoomFromSolid(geo=flatten(data), conditioned=True)  # -> report, rooms; plug-in component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
aperturesbyratio = HBAperturesByRatio(
    hb_objs=flatten(roomsolid.rooms),
    ratio=number_slider_5,
    subdivide=panel_2,
    win_height=number_slider,
    sill_height=number_slider_4,
    horiz_separ=number_slider_2,
    vert_separ=number_slider_3)  # -> report, hb_objs; plug-in component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
preview_rooms = Panel(aperturesbyratio.hb_objs)

# ----
tvis = Panel("0.810")

glassmod = HBGlassModifier(name="replace_mat", trans=tvis)  # -> modifier; plug-in component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
subfacesubset = HBSubfaceModifierSubset(window=glassmod)  # -> subface_set; plug-in component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
modifierset = HBModifierSet(exterior_subset=exteriorsubset, interior_subset=interiorsubset, subface_subset=subfacesubset)  # -> mod_set; plug-in component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

# ---- group: Applying Radiance modifiers to rooms
# Daylight - raytracing
applymodset = HBApplyModifierSet(rooms=aperturesbyratio.hb_objs, mod_set=modifierset)  # -> rooms; plug-in component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
model = HBModel(rooms=flatten(applymodset), name="Daylight")  # -> report, model; plug-in component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

# ----
gridrooms = HBSensorGridFromRooms(rooms=applymodset, grid_size=number_slider_6, dist_floor=panel_3)  # -> grid, points, mesh; plug-in component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
panel_5 = Panel("C:\Users\Pedersen_Admin\OneDrive - Perkins and Will\Documents\GitHub\VMT_VS\Tests_matmul\Geometry")

flatten = FlattenTree(Tree=gridrooms.points, Path="{0}")
assigngridsviews = HBAssignGridsAndViews(model=model.model, grids=flatten(gridrooms.grid))  # -> model; plug-in component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
lng = ListLength(List=flatten)
daylight = Panel(lng)

panel_6 = Panel(gridrooms.mesh)

facen = FaceNormals(Mesh=gridrooms.mesh)  # -> Centers, Normals
vdis = VectorDisplay(Anchor=facen.Centers, Vector=facen.Normals)

# ----
# 2PM
concat = Concatenate(FragmentA=panel_5, FragmentB="\Raytracing")
modeltorad = HBModelToRadFolder(model=assigngridsviews, folder=concat, write=Toggle(False))  # -> report, folder; plug-in component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
