# Grasshopper definition tests_raytracing.gh (Grasshopper 1.0.7)
# plug-ins: Kangaroo2 Components

# ---- group: Rooms
brep = Brep([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])

# ---- group: Context
brep_2 = Brep([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])

# ----
roomsolid = HBRoomFromSolid(geo=flatten(brep), conditioned=True)  # -> report, rooms; plug-in component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
shade = HBShade(geo=brep_2)  # -> report, shades; plug-in component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
aperturesbyratio = HBAperturesByRatio(
    hb_objs=flatten(roomsolid.rooms),
    ratio=Slider(0.4, range=0..1),
    subdivide="True",
    win_height=Slider(1.2, range=0..4),
    sill_height=Slider(0.6, range=0..4),
    horiz_separ=Slider(1, range=0..4),
    vert_separ=Slider(0, range=0..4))  # -> report, hb_objs; plug-in component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
model = HBModel(rooms=flatten(aperturesbyratio.hb_objs), shades=flatten(shade.shades))  # -> report, model; plug-in component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
vizbytype = HBVisualizeByType(hb_objs=model.model)  # -> walls, interior_walls, roofs, ceilings, exterior_floors, interior_floors, air_walls, apertures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; plug-in component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

# ---- group: Initial test of setup / Test
brep_3 = Brep([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])

# ----
opaquemod = HBOpaqueModifier(name="Wall_rad_mat", reflect="0.5", spec="0", rough="0")  # -> modifier; plug-in component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
opaquemod_2 = HBOpaqueModifier(name="Floor_rad_mat", reflect="0.2", spec="0", rough="0")  # -> modifier; plug-in component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
opaquemod_3 = HBOpaqueModifier(name="Ceiling_rad_mat", reflect="0.8", spec="0", rough="0")  # -> modifier; plug-in component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
glassmod = HBGlassModifier(name="Window_rad_mat", trans="0.81")  # -> modifier; plug-in component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
opaquemod_4 = HBOpaqueModifier(name="Context_rad_mat", reflect="0.2", spec="0", rough="0")  # -> modifier; plug-in component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

# ---- group: Initial test of setup
mesh = Mesh(brep_3)
tri = Triangulate(Mesh=mesh)  # -> Mesh, Count
refine = Refine(Mesh=tri.Mesh, Level=Slider(0, range=0..5))
demesh = DeconstructMesh(Mesh=refine)  # -> Vertices, Faces, Colours, Normals
flatten = FlattenTree(Tree=demesh.Vertices, Path="{0}")
flatten_2 = FlattenTree(Tree=demesh.Faces, Path="{0}")
lng = ListLength(List=flatten)
lng_2 = ListLength(List=flatten_2)
panel = Panel(lng)
panel_2 = Panel(lng_2)

# ---- group: Floors unmodified
mesh_2 = Mesh(vizbytype.exterior_floors)

# ---- group: one option
gridrooms = HBSensorGridFromRooms(rooms=model.model, grid_size=Slider(1, range=0.01..1), dist_floor="0.5")  # -> grid, points, mesh; plug-in component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
flatten_3 = FlattenTree(Tree=gridrooms.points, Path="{0}")
lng_3 = ListLength(List=flatten_3)
panel_3 = Panel(lng_3)

# ---- group: Flip
# Control number of sensorpoints
flipm = FlipMesh(Mesh=mesh_2, VertexNormals=True, FaceNormals=True, FaceOrientation=True)

# ---- group: Move
vec = VectorXYZ(XComponent="0", YComponent="0", ZComponent="0.5")  # -> Vector, Length
move = Move(Geometry=flipm, Motion=vec.Vector)  # -> Geometry, Transform

# ----
number_slider = Slider(0, range=0..10)
panel_4 = Panel("C:\Users\Pedersen_Admin\OneDrive - Perkins and Will\Documents\GitHub\VMT_VS\Tests_raytracing")
python = GhPythonScript(y=Slider(0, range=0..59))  # -> out, geo_idx, pts_idx
# ---------- python: Python ----------
__author__ = "Pedersen_Admin"
__version__ = "2021.05.21"

import rhinoscriptsyntax as rs

geo_idx_list = []
pts_idx_list = []

for i in range(6):
    for j in range(10):
        geo_idx_list.append(i)
        pts_idx_list.append(j)

#print(geo_idx)
#print(pts_idx)

#print(len(geo_idx))
#print(len(pts_idx))

geo_idx = geo_idx_list[int(y)]
pts_idx = pts_idx_list[int(y)]
# ---------- end python ----------

tri_2 = Triangulate(Mesh=vizbytype.walls)  # -> Mesh, Count
tri_3 = Triangulate(Mesh=vizbytype.roofs)  # -> Mesh, Count
tri_4 = Triangulate(Mesh=vizbytype.apertures)  # -> Mesh, Count
tri_5 = Triangulate(Mesh=vizbytype.exterior_floors)  # -> Mesh, Count
tri_6 = Triangulate(Mesh=vizbytype.outdoor_shades)  # -> Mesh, Count
refine_2 = Refine(Mesh=tri_2.Mesh, Level=python.geo_idx)
refine_3 = Refine(Mesh=tri_3.Mesh, Level=python.geo_idx)
refine_4 = Refine(Mesh=tri_5.Mesh, Level=python.geo_idx)
refine_5 = Refine(Mesh=tri_6.Mesh, Level=python.geo_idx)
refine_6 = Refine(Mesh=tri_4.Mesh, Level=python.geo_idx)
face = HBFace(geo=refine_3, name="Roofs", rad_mod=opaquemod_3)  # -> report, faces; plug-in component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
face_2 = HBFace(geo=refine_2, name="Ext_walls", rad_mod=opaquemod)  # -> report, faces; plug-in component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
face_3 = HBFace(geo=refine_4, name="Floors", rad_mod=opaquemod_2)  # -> report, faces; plug-in component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
shade_2 = HBShade(geo=refine_5, name="Shades", rad_mod=opaquemod_4)  # -> report, shades; plug-in component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
aperture = HBAperture(geo=refine_6, name="Windows", rad_mod=glassmod)  # -> report, apertures; plug-in component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

refine_7 = Refine(Mesh=move.Geometry, Level=python.pts_idx)
facen = FaceNormals(Mesh=refine_7)  # -> Centers, Normals
panel_5 = Panel(refine_7)
flatten_4 = FlattenTree(Tree=facen.Centers, Path="{0}")
vdis = VectorDisplay(Anchor=facen.Centers, Vector=facen.Normals)
sensorgrid = HBSensorGrid(positions=facen.Centers, directions=facen.Normals)  # -> grid; plug-in component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
lng_4 = ListLength(List=flatten_4)

# ----
# Control triangle subdivision
data = Data([face_2.faces, face.faces, face_3.faces, aperture.apertures, shade_2.shades])
flatten_5 = FlattenTree(Tree=data, Path="{0}")
number_slider_2 = Slider(0, range=0..5)
lng_5 = ListLength(List=flatten_5)

panel_6 = Panel(lng_5)
panel_7 = Panel(lng_4)
concat = Concatenate(
    FragmentA="Triangles",
    FragmentB="_",
    FragmentC=panel_6,
    FragmentD="__",
    FragmentE="Points",
    FragmentF="_",
    FragmentG=panel_7)
panel_8 = Panel(python.geo_idx)
panel_9 = Panel(python.pts_idx)
panel_10 = Panel(concat)
model_2 = HBModel(
    faces=flatten([face_2.faces, face.faces, face_3.faces]),
    shades=flatten(shade_2.shades),
    apertures=flatten(aperture.apertures),
    name=panel_10)  # -> report, model; plug-in component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
assigngridsviews = HBAssignGridsAndViews(model=model_2.model, grids=flatten(sensorgrid))  # -> model; plug-in component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
vizbytype_2 = HBVisualizeByType(hb_objs=model_2.model)  # -> walls, interior_walls, roofs, ceilings, exterior_floors, interior_floors, air_walls, apertures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; plug-in component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
modeltorad = HBModelToRadFolder(model=assigngridsviews, folder=panel_4, write=Toggle(False))  # -> report, folder; plug-in component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

panel_11 = Panel("C:\Users\Tubsp\OneDrive\Dokumenter\GitHub\VMT_VS\Tests_convergence\Triangles_3500__Points_4096\Radiance\model\aperture\aperture.rad")
panel_12 = Panel("C:\Users\Tubsp\OneDrive\Dokumenter\GitHub\VMT_VS\Tests_convergence\Triangles_3500__Points_4096\Radiance\model\scene\envelope.rad")
panel_13 = Panel("C:\Users\Tubsp\OneDrive\Dokumenter\GitHub\VMT_VS\Tests_convergence\Triangles_3500__Points_4096\Radiance\model\scene\shades.rad")
# Double check
importrad = Honeybee_ImportRad(radianceFile=panel_12)  # -> RADMaterials, RADSurfaces; disabled; plug-in component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
importrad_2 = Honeybee_ImportRad(radianceFile=panel_13)  # -> RADMaterials, RADSurfaces; disabled; plug-in component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
importrad_3 = Honeybee_ImportRad(radianceFile=panel_11)  # -> RADMaterials, RADSurfaces; disabled; plug-in component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
data_2 = Data([importrad.RADSurfaces, importrad_2.RADSurfaces, importrad_3.RADSurfaces])
flatten_6 = FlattenTree(Tree=data_2, Path="{0}")
lng_6 = ListLength(List=flatten_6)
# Hourly heating and cooling load
# Hourly cooling load
# Hourly heating load
panel_14 = Panel(lng_6)
