# Grasshopper definition geometry.gh (Grasshopper 1.0.7)
# plug-ins: MeshEdit Components

# ---- group: This is created for LBT version 1.2.0
# Inputs
panel = Panel("1.2.0")
versioner = LBVersioner(update=Toggle(False), version=panel)  # -> Vviiiiiz; plug-in component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

# ---- group: Window parameters
number_slider = Slider(1.2, range=0..4)
number_slider_2 = Slider(1, range=0..4)
number_slider_3 = Slider(0, range=0..4)
number_slider_4 = Slider(0.6, range=0..4)
number_slider_5 = Slider(0.4, range=0..1)
panel_2 = Panel("True")

# ---- group: Daylight grid parameters
number_slider_6 = Slider(0.2, range=0.2..3)
panel_3 = Panel("0.85")

# ---- group: Context
brep = Brep(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)

# ---- group: Rooms
brep_2 = Brep(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)

# ---- group: Selected context
data = Data(brep)

# ---- group: Selected geometry
data_2 = Data(brep_2)

# ----
opaquemod = HBOpaqueModifier(name="Floor_rad_mat", reflect="0.2", spec="0", rough="0")  # -> modifier; plug-in component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
opaquemod_2 = HBOpaqueModifier(name="Ceiling_rad_mat", reflect="0.8", spec="0", rough="0")  # -> modifier; plug-in component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
opaquemod_3 = HBOpaqueModifier(name="Wall_rad_mat", reflect="0.5", spec="0", rough="0")  # -> modifier; plug-in component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
# Radiance modifiers
exteriorsubset = HBExteriorModifierSubset(exterior_wall=opaquemod_3, exterior_roof=opaquemod_2, exposed_floor=opaquemod)  # -> exterior_set; plug-in component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
interiorsubset = HBInteriorModifierSubset(interior_wall=opaquemod_3, ceiling=opaquemod_2, interior_floor=opaquemod)  # -> interior_set; plug-in component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

# ---- group: Windows by ratio
roomsolid = HBRoomFromSolid(geo=flatten(data_2), conditioned=True)  # -> report, rooms; plug-in component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
aperturesbyratio = HBAperturesByRatio(
    hb_objs=flatten(roomsolid.rooms),
    ratio=number_slider_5,
    subdivide=panel_2,
    win_height=number_slider,
    sill_height=number_slider_4,
    horiz_separ=number_slider_2,
    vert_separ=number_slider_3)  # -> report, hb_objs; plug-in component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
preview_rooms = Panel(aperturesbyratio.hb_objs)

# ----
tvis = Panel("0.810")

glassmod = HBGlassModifier(name="replace_mat", trans=tvis)  # -> modifier; plug-in component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
subfacesubset = HBSubfaceModifierSubset(window=glassmod)  # -> subface_set; plug-in component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
modifierset = HBModifierSet(exterior_subset=exteriorsubset, interior_subset=interiorsubset, subface_subset=subfacesubset)  # -> mod_set; plug-in component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

# ---- group: Context
opaquemod_4 = HBOpaqueModifier(name="Context_rad_mat", reflect="0.2", spec="0", rough="0")  # -> modifier; plug-in component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
shade = HBShade(geo=data, rad_mod=opaquemod_4)  # -> report, shades; plug-in component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

# ---- group: Applying Radiance modifiers to rooms
# Daylight - raytracing
applymodset = HBApplyModifierSet(rooms=aperturesbyratio.hb_objs, mod_set=modifierset)  # -> rooms; plug-in component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
model = HBModel(rooms=flatten(applymodset), shades=flatten(shade.shades), name="Daylight")  # -> report, model; plug-in component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

# ----
panel_5 = Panel("C:\Users\Pedersen_Admin\OneDrive - Perkins and Will\Documents\GitHub\VMT_VS\Tests_versions\3PM\Raytracing\Daylight\Radiance\model\aperture\aperture.rad")
importrad = Honeybee_ImportRad(radianceFile=panel_5)  # -> RADMaterials, RADSurfaces; plug-in component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
panel_6 = Panel(importrad.RADSurfaces)
facen = FaceNormals(Mesh=importrad.RADSurfaces)  # -> Centers, Normals
vdis = VectorDisplay(Anchor=facen.Centers, Vector=facen.Normals)

# ---- group: Vizualizing/preview of model
vizbytype = HBVisualizeByType(hb_objs=model.model)  # -> walls, interior_walls, roofs, ceilings, exterior_floors, interior_floors, air_walls, apertures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; plug-in component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

# ----
gridrooms = HBSensorGridFromRooms(rooms=applymodset, grid_size=number_slider_6, dist_floor=panel_3)  # -> grid, points, mesh; plug-in component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
should_not_contain_whitespace = Panel("C:\Users\Pedersen_Admin\OneDrive - Perkins and Will\Documents\GitHub\VMT_VS\Tests_versions\2PM")

flatten = FlattenTree(Tree=gridrooms.points, Path="{0}")
assigngridsviews = HBAssignGridsAndViews(model=model.model, grids=flatten(gridrooms.grid))  # -> model; plug-in component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
lng = ListLength(List=flatten)
daylight = Panel(lng)

panel_7 = Panel(gridrooms.mesh)

facen_2 = FaceNormals(Mesh=gridrooms.mesh)  # -> Centers, Normals
vdis_2 = VectorDisplay(Anchor=facen_2.Centers, Vector=facen_2.Normals)

flip = MeshFlip(Mesh=vizbytype.apertures)
explode = MeshExplode(Mesh=flip, Interpolate=False)
should_not_contain_whitespace_2 = Panel("C:\Users\Pedersen_Admin\OneDrive - Perkins and Will\Documents\GitHub\VMT_VS\Tests_versions\3PM")
aperture = HBAperture(geo=flip, rad_mod=glassmod)  # -> report, apertures; plug-in component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
face = HBFace(geo=vizbytype.walls, rad_mod=opaquemod_3)  # -> report, faces; plug-in component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
face_2 = HBFace(geo=vizbytype.roofs, rad_mod=opaquemod_2)  # -> report, faces; plug-in component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
face_3 = HBFace(geo=vizbytype.exterior_floors, rad_mod=opaquemod)  # -> report, faces; plug-in component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
panel_8 = Panel(aperture.apertures)
data_3 = Data(aperture.apertures)
# 3PM
model_2 = HBModel(
    faces=flatten([face.faces, face_2.faces, face_3.faces]),
    shades=flatten(shade.shades),
    apertures=flatten(aperture.apertures),
    name="Daylight")  # -> report, model; plug-in component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

# ----
# 2PM
concat = Concatenate(FragmentA=should_not_contain_whitespace, FragmentB="\Raytracing")
modeltorad = HBModelToRadFolder(model=assigngridsviews, folder=concat, write=Toggle(False))  # -> report, folder; plug-in component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

panel_9 = Panel("C:\Users\Pedersen_Admin\OneDrive - Perkins and Will\Documents\GitHub\VMT_VS\Tests_versions\3PM\simulation_")

concat_2 = Concatenate(FragmentA=should_not_contain_whitespace_2, FragmentB="\Raytracing")
modeltorad_2 = HBModelToRadFolder(model=model_2.model, folder=concat_2, write=Toggle(False))  # -> report, folder; plug-in component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

# ----
# C:\Users\Pedersen_Admin\OneDrive - Perkins and Will\Documents\GitHub\VMT_VS\Tests_versions\2PM_da.pkl
number_slider_7 = Slider(20, range=0..23)
item = ListItem(List=explode, Index=number_slider_7, Wrap=True)
mesh = Mesh(item)
concat_3 = Concatenate(FragmentA=panel_9, FragmentB=number_slider_7, FragmentC="\da.pkl")

# ---- group: DA
python = GhPythonScript(da_file=concat_3)  # -> out, DA
# ---------- python: Python ----------
__author__ = "Pedersen_Admin"
__version__ = "2021.04.21"

import cPickle as pickle
import rhinoscriptsyntax as rs



with open(da_file, 'rb') as pkl_file:
    DA = pickle.load(pkl_file)
# ---------- end python ----------
# Display DA output
panel_10 = Panel(python.DA)
listtotree = ListToTree(PythonList=python.DA)  # -> DataTree; inputs PythonList: list, BasePath: list of Int32
# ---------- listtotree: Python ----------
from Grasshopper import DataTree as Tree
from Grasshopper.Kernel.Data import GH_Path as Path
from System import Array

def list_to_tree(input, none_and_holes=False, base_path=[0]):
    """Transforms nestings of lists or tuples to a Grasshopper DataTree"""
    
    def process_one_item(input,tree,track):
        path = Path(Array[int](track))
        if len(input) == 0 and none_and_holes: tree.EnsurePath(path); return
        for i,item in enumerate(input):
            if hasattr(item, '__iter__'): #if list or tuple
                track.append(i); process_one_item(item,tree,track); track.pop()
            else:
                if none_and_holes: tree.Insert(item,path,i)
                elif item is not None: tree.Add(item,path)
    tree = Tree[object]()
    if input is not None: process_one_item(input,tree,base_path[:]); return tree
    

pythonList = PythonList or []
None_and_holes = False
Base_path = BasePath or [0]


DataTree = list_to_tree(pythonList,none_and_holes = None_and_holes, base_path= Base_path)
# ---------- end listtotree ----------
flatten_2 = FlattenTree(Tree=listtotree, Path="{0}")
python_2 = GhPythonScript(da_list=flatten_2)  # -> out, minimum, maximum; inputs da_list: list
# ---------- python_2: Python ----------
__author__ = "Pedersen_Admin"
__version__ = "2021.04.21"

import rhinoscriptsyntax as rs

try:
    minimum = min(da_list)
    maximum = max(da_list)
except:
    pass
# ---------- end python_2 ----------
legendpar = LBLegendParameters(min=python_2.minimum, max=python_2.maximum)  # -> leg_par; plug-in component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
graft = GraftTree(Tree=gridrooms.mesh, IncludeEmptyLists=True, IncludeNullItems=True)
panel_11 = Panel(listtotree)
heatmap = LBSpatialHeatmap(values=listtotree, mesh=graft, legend_par=legendpar)  # -> mesh, legend, title, colors, legend_par; plug-in component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

# ---- group: Above 50 % sDA or not
python_3 = GhPythonScript(DA=listtotree)  # -> out, DA_above_50; inputs DA: list
# ---------- python_3: Python ----------
__author__ = "Pedersen_Admin"
__version__ = "2021.04.28"

import rhinoscriptsyntax as rs

DA_above_50 = []

for i in range(len(DA)):
    if DA[i] >= 50:
        DA_above_50.append(1)
    else: 
        DA_above_50.append(0)
# ---------- end python_3 ----------
graft_2 = GraftTree(Tree=gridrooms.mesh, IncludeEmptyLists=True, IncludeNullItems=True)
legendpar_2 = LBLegendParameters(min="0", max="1")  # -> leg_par; plug-in component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
heatmap_2 = LBSpatialHeatmap(values=python_3.DA_above_50, mesh=graft_2, legend_par=legendpar_2)  # -> mesh, legend, title, colors, legend_par; plug-in component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

# ---- group: sDA
python_4 = GhPythonScript(DA=listtotree)  # -> out, sDA; inputs DA: list
# ---------- python_4: Python ----------
__author__ = "Pedersen_Admin"
__version__ = "2021.04.28"

import rhinoscriptsyntax as rs

try:
    sDA = 0
    for i in range(len(DA)):
        if DA[i] > 50:
            sDA += 1
            
    sDA = (sDA/len(DA))*100
except:
    pass
# ---------- end python_4 ----------
panel_12 = Panel(python_4.sDA)

# ---- group: Above 50 % sDA or not
bang = ExplodeTree(Data=heatmap_2.legend)
mesh_2 = Mesh(heatmap_2.mesh)

# ---- group: DA
bang_2 = ExplodeTree(Data=heatmap.legend)
# Hourly heating and cooling load
# Hourly cooling load
# Hourly heating load
# Air temperature
# Zone total solar heat gain
# Window solar heat gain
# Window outside solar heat gain
mesh_3 = Mesh(heatmap.mesh)
